# Grasshopper definition 03_collision_rrt.ghx (Grasshopper 1.0.8)
# plug-ins: Motus
# Collision-aware RRT: ColSphere -> ColScene -> Plan.Collision with joint goal. Click Plan, then drag Motus Scrub or Play.

number_slider = Slider(10, range=0..10)
pt = Point("0,0,-0.15")
crv = Curve(reparameterize([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]))
mp = MultiPipe(Curves=crv, NodeSize=Slider(0.06, range=0..0.1), EndOffset=1, StrutSize=1, Segment=0, KinkAngle=0.6, CubeFit=0, Caps=1)
colbox = MotusCollisionBox(Plane=pt, HalfX=number_slider, HalfY=number_slider, HalfZ=0.1, Name="box")  # disabled
mesh = Mesh(mp)
meshsubd = MeshFromSubD(SubD=mp, Density=0)
colmesh = MotusCollisionMesh(Geometry=meshsubd, Plane=PlaneXY(0, 0, 0), Name="mesh")
joints = MotusJointState(Joints=[1.2, -1, 1.2, -1.6, -1.5708, 0])
colscene = MotusCollisionScene(Objects=flatten([colmesh, colbox]))  # -> Scene, Groups, EndEffectors
ur10e = MotusUR10eRobotiq(ShowCollisionPreview=False)
plan = MotusPlan(Robot=ur10e, Goal=joints, Step=0.005, Collision=colscene.Scene, AutoPlan=False)  # -> Trajectory, Status, Warnings
data = MotusTrajectoryData(Trajectory=plan.Trajectory)  # -> Planes, Times, Joints, ToolStates
panel = Panel(plan.Warnings)
scrub = Slider(0, range=0..1)
item = ListItem(List=data.Planes, Index=[5, 16, 24], Wrap=True)
panel_2 = Panel(plan.Status)
preview = MotusPreview(Trajectory=plan.Trajectory, ShowStart=False, Position=scrub, ColorMode=0, ShowCustomColors=False)  # -> Meshes, Links, TCPPath, State, Time, Index, Invalid, ToolState, Width
