# Grasshopper definition 06_turntable_group.ghx (Grasshopper 1.0.8)
# plug-ins: Motus
# UR10e+turntable: GH fixture box → Robot Attach on turntable_link (TreeFK); AllDrivers multi-waypoint Robotiq TCP tracks spoke corner.

# ---- group: Fixture → turntable_link
# Note: Fixture: Box → Robot At; Point → Ao on turntable_link (TreeFK). AllDrivers Plan moves arm + turntable together — scrub Preview (Show TCP) to watch TCP track the spoke.
xy = XYPlane()
box = CenterBox(Base=xy, X=0.02, Y=0.02, Z=0.02)
goalpt = ConstructPoint(X=0.275, Y=0.025, Z=0.035)

# ---- group: Prefab UR10e + turntable
# 06  UR + Turntable
path = FilePath("/Users/lasaths/Documents/GitHub/Motus.Grasshopper/resources/robots/ur10e_robotiq/ur10e_with_turntable.xacro")
joints = MotusJointState(Joints=[-0.1539, -1.003, 1.4702, -2.038, -1.5708, -1.7247, 0])
joints_2 = MotusJointState(Joints=[-0.0487, -1.0357, 1.5236, -2.0587, -1.5708, -1.6195, 0.3927])
joints_3 = MotusJointState(Joints=[0.0431, -1.1099, 1.6412, -2.1022, -1.5708, -1.5277, 0.7854])
joints_4 = MotusJointState(Joints=[0.1125, -1.2196, 1.8057, -2.1569, -1.5708, -1.4583, 1.1781])
joints_5 = MotusJointState(Joints=[0.1456, -1.3596, 1.9966, -2.2078, -1.5708, -1.4252, 1.5708])
merge = Merge(Data1=joints_2, Data2=joints_3, Data3=joints_4, Data4=joints_5)
robot = MotusRobot(
    Path=path,
    BaseLink="world",
    TipLink="tool0",
    AllDrivers=True,
    Attach=box,
    AttachLink="turntable_link",
    AttachOrigin=goalpt)

# ---- group: Plan + Preview
quick = MotusPlan(
    Robot=robot,
    Goal=merge,
    Start=joints,
    Step=0.005,
    AutoPlan=True,
    ShowCollision=False,
    ShowGroup=False,
    ShowAttach=False,
    ShowRrtSettings=False)  # -> Trajectory, Status, Warnings
scrub = Slider(0, range=0..1)
preview = MotusPreview(Trajectory=quick.Trajectory, ShowStart=True, Position=scrub, ColorMode=0, ShowCustomColors=False, ShowDebugOutputs=False)  # -> Meshes, Links, TCPPath, State, Time
