# Grasshopper definition 06_urdf_load.ghx (Grasshopper 1.0.8)
# plug-ins: Motus
# URDF import: ur10e_robotiq.urdf (arm + gripper meshes, local paths). Run fetch-ur10e-assets.mjs. Bundled Robotiq tool applied automatically.

goal = Panel("""0
-80
0
-90
0
0""")
path = FilePath("examples/ur10e/ur10e_robotiq.urdf")
urdf = MotusLoadURDF(Path=path, BaseLink="base_link", TipLink="tool0")
start = Panel("""0
-90
0
-90
0
0""")
joints = MotusJointState(Joints=goal)
joints_2 = MotusJointState(Joints=start)
plan = MotusPlan(Robot=urdf, Goal=joints, Start=joints_2)  # -> Trajectory, Status, Warnings
preview = MotusPreview(Trajectory=plan.Trajectory, ShowStart=False, Robot=urdf)  # -> Meshes, Links, TCPPath, State, Time, Index, Invalid
