# Grasshopper definition 07_urdf_gripper_tool.ghx (Grasshopper 1.0.8)
# plug-ins: Motus
# Boxes→ULink→UJoint→Assemble→Tool Rd (Cap schema, Bd=j_left)→ur10e_minimal→PTP Ramp Closed→Preview pinch.

# ---- group: Author gripper
# 07 · Gripper Tool pinch
xy = XYPlane()
box = CenterBox(Base=xy, X=0.12, Y=0.08, Z=0.04)
box_2 = CenterBox(Base=xy, X=0.06, Y=0.025, Z=0.12)
box_3 = CenterBox(Base=xy, X=0.06, Y=0.025, Z=0.12)
ulink = MotusUrdfLink(Name="palm", Visual=box)
ulink_2 = MotusUrdfLink(Name="L", Visual=box_2)
ulink_3 = MotusUrdfLink(Name="R", Visual=box_3)
# Note: L→R: boxes→Assemble→Tool (Cap=schema, Bd=j_left)→Robot→PTP Ramp Closed. Scrub = pinch.
Z = UnitZ()
goalpt = ConstructPoint(X=0, Y=0.045, Z=0)
goalpt_2 = ConstructPoint(X=0, Y=-0.045, Z=0)
ln = LineSDL(Start=goalpt, Direction=Z, Length=0.05)
ln_2 = LineSDL(Start=goalpt_2, Direction=Z, Length=0.05)
ujoint = MotusUrdfJoint(Name="j_left", Type="Revolute", Parent="palm", Child="L", Axis=ln, Lower=0, Upper=0.8, MimicMult=1, MimicOffset=0)
ujoint_2 = MotusUrdfJoint(
    Name="j_right",
    Type="Revolute",
    Parent="palm",
    Child="R",
    Axis=ln_2,
    Lower=0,
    Upper=0.8,
    MimicJoint="j_left",
    MimicMult=-1,
    MimicOffset=0)
merge = Merge(Data1=ulink, Data2=ulink_2, Data3=ulink_3)
merge_2 = Merge(Data1=ujoint, Data2=ujoint_2)
uassemble = MotusUrdfAssemble(Name="demo_gripper", Links=merge, Joints=merge_2, Tip="palm")

# ---- group: Tool Rd
tool = MotusTool(
    Name="demo_gripper",
    Description=uassemble,
    Binding="j_left",
    WidthMin=0,
    WidthMax=0.085,
    ClosedDriver=0.8,
    ToolCapabilities="Robotiq2F85",
    CanvasPivotX=1108,
    CanvasPivotY=242)
toolstate = MotusToolState(Tool=tool, Width=0.085, Speed=0.5, Force=0.5, ToolStatePreset="Closed", CanvasPivotX=1108, CanvasPivotY=472)

# ---- group: Arm + Preview
path = FilePath("C:\Users\lasaths\GitHub\Motus.Grasshopper\examples\ur10e\ur10e_minimal.urdf")
robot = MotusRobot(Path=path, BaseLink="base_link", TipLink="tool0", Tool=tool, AllDrivers=False, AttachOrigin=[0, 0, 0])
joints = MotusJointState(Joints=[0, -1.2, 1.2, -1.6, -1.5708, 0])
joints_2 = MotusJointState(Joints=[1.2, -1, 1.2, -1.6, -1.5708, 0])
move = MotusMove(
    Type="PTP",
    Goal=joints_2,
    Blend=0,
    ToolState=toolstate,
    MotionType="PTP",
    ToolMode="Ramp",
    CanvasPivotX=1437,
    CanvasPivotY=622)
program = MotusProgram(Robot=robot, Segments=move, Start=joints, AutoPlan=True)  # -> Trajectory, Status, Warnings
scrub = Slider(0, range=0..1)
preview = MotusPreview(
    Trajectory=program.Trajectory,
    ShowStart=True,
    Position=scrub,
    ColorMode=0,
    ShowCustomColors=False,
    ShowDebugOutputs=False)  # -> Meshes, Links, TCPPath, State, Time
