# Grasshopper definition 08_stewart_tcp_path.ghx (Grasshopper 1.0.8)
# plug-ins: Motus
# Motus Stewart classic hex → Plan Start/Goal TCP planes → Preview scrub + Waypoints (leg lengths in meters). Requires Motus.NET ≥ 0.9.0 (-UseLocal until NuGet publish).

# 08 · Stewart TCP path
# Note: Motus Stewart (classic hex) → Plan with TCP planes → Preview. Q = leg lengths (m), not UR MoveJ.
stewart = MotusStewart(BaseRadius=0.5, PlatformRadius=0.3, MinStroke=0.35, MaxStroke=0.9, Name="stewart_classic")

# ---- group: Plan TCP
Z = UnitZ()
goalpt = ConstructPoint(X=0, Y=0, Z=0.625)
goalpt_2 = ConstructPoint(X=0.01, Y=0, Z=0.625)
pl = PlaneNormal(Origin=goalpt, ZAxis=Z)
pl_2 = PlaneNormal(Origin=goalpt_2, ZAxis=Z)
quick = MotusPlan(
    Robot=stewart,
    Goal=pl_2,
    Start=pl,
    Step=0.005,
    AutoPlan=True,
    ShowCollision=False,
    ShowGroup=False,
    ShowAttach=False,
    ShowRrtSettings=False)  # -> Trajectory, Status, Warnings
scrub = Slider(0, range=0..1)
waypoints = MotusWaypoints(Trajectory=quick.Trajectory, Decimate=1)  # -> Joints, Planes, Times
preview = MotusPreview(Trajectory=quick.Trajectory, ShowStart=True, Position=scrub, ColorMode=0, ShowCustomColors=False, ShowDebugOutputs=False)  # -> Meshes, Links, TCPPath, State, Time
