# Grasshopper definition 09_walking_hexapod.ghx (Grasshopper 1.0.8)
# plug-ins: Motus
# Walking hexapod: arc planes + Terrain box → WalkHex foot-target IK gait (18-DOF + mobile base) → Preview + Scrub. Not Stewart; no Motus Plan on gait path.

# ---- group: Walking Hex path
# 09 · Walking hexapod
# Note: WalkHex Planes + Terrain (ground box) → foot-target IK gait → Preview + Scrub. Feet plant via downward ray; omit Tn = flat Z=0. Swap Tn for a Mesh ramp for uneven ground. No Motus Plan on this path.
Z = UnitZ()
goalpt = ConstructPoint(X=0.04, Y=2.2e-17, Z=0.02)
goalpt_2 = ConstructPoint(X=0.05370168415, Y=0.06888301783, Z=0.02)
goalpt_3 = ConstructPoint(X=0.09272077939, Y=0.1272792206, Z=0.02)
goalpt_4 = ConstructPoint(X=0.1511169822, Y=0.1662983159, Z=0.02)
goalpt_5 = ConstructPoint(X=0.22, Y=0.18, Z=0.02)
goalpt_6 = ConstructPoint(X=0.2888830178, Y=0.1662983159, Z=0.02)
goalpt_7 = ConstructPoint(X=0.3472792206, Y=0.1272792206, Z=0.02)
goalpt_8 = ConstructPoint(X=0.3862983159, Y=0.06888301783, Z=0.02)
goalpt_9 = ConstructPoint(X=0.4, Y=0, Z=0.02)
pl = PlaneNormal(Origin=goalpt, ZAxis=Z)
pl_2 = PlaneNormal(Origin=goalpt_2, ZAxis=Z)
pl_3 = PlaneNormal(Origin=goalpt_3, ZAxis=Z)
pl_4 = PlaneNormal(Origin=goalpt_4, ZAxis=Z)
pl_5 = PlaneNormal(Origin=goalpt_5, ZAxis=Z)
pl_6 = PlaneNormal(Origin=goalpt_6, ZAxis=Z)
pl_7 = PlaneNormal(Origin=goalpt_7, ZAxis=Z)
pl_8 = PlaneNormal(Origin=goalpt_8, ZAxis=Z)
pl_9 = PlaneNormal(Origin=goalpt_9, ZAxis=Z)
goalpt_10 = ConstructPoint(X=0.22, Y=0, Z=0)
merge = Merge(Data1=pl, Data2=pl_2, Data3=pl_3, Data4=pl_4, Data5=pl_5, Data6=pl_6, Data7=pl_7, Data8=pl_8, Data9=pl_9)
pl_10 = PlaneNormal(Origin=goalpt_10, ZAxis=Z)
box = CenterBox(Base=pl_10, X=0.7, Y=0.55, Z=0.04)
walkhex = MotusWalkingHex(
    BodyR=0.06,
    Coxa=0.035,
    Femur=0.08,
    Tibia=0.1,
    HipStance=0.1309,
    FemurStance=0.5236,
    TibiaStance=-0.5236,
    BodyZ=0.07,
    Planes=merge,
    Speed=0.06,
    Step=0.04,
    Lift=0.02,
    Terrain=box)  # -> Robot, State, Trajectory, PathCurve, PathPlanes, Meshes, Support

# ---- group: Gait Preview
scrub = Slider(0, range=0..1)
preview = MotusPreview(
    Trajectory=walkhex.Trajectory,
    ShowStart=True,
    Position=scrub,
    ColorMode=0,
    ShowCustomColors=False,
    ShowDebugOutputs=False)  # -> Meshes, Links, TCPPath, State, Time
